# Grasshopper definition fractal_tree_00.gh (Grasshopper 1.0.4)

range = Range(Domain=Slider(10000, range=0..10000), Steps=10)
construct_point = ConstructPoint(XCoordinate=0, YCoordinate=range, ZCoordinate=Slider(0, range=0..20000))
length_randomness = Slider(83, range=0..100)
angle_randomness = Slider(23, range=0..100)
depth = Slider(8, range=1..8)
max_angle = Slider(27, range=5..90)
starting_length = Slider(241, range=50..1000)
length_change = Slider(0.7, range=-0.1..0.9)
unit_y = UnitY(Factor=1)
line_sdl = LineSDL(Start=construct_point, Direction=unit_y, Length=Slider(1, range=0..1))
ghpython_script = GhPythonScript(
    anchorp=construct_point,
    depth=depth,
    angle=max_angle,
    length=starting_length,
    lvariation=length_change,
    aran=angle_randomness,
    lran=length_randomness)  # -> treelin, treept; inputs anchorp: Point3d
# ---------- ghpython_script: Python ----------
#importing grasshopper python modules
import rhinoscriptsyntax as rs
import Rhino.Geometry as rg

#importing generic modules
from math import cos
from math import sin
from math import radians
import random

#getting starting point from anchorpoint
x1 = anchorp.X
y1 = anchorp.Y
z1 = anchorp.Z

#setting base variables
x2 = x1
y2 = y1
z2 = z1

#base angle
anglerec = 0

#list of lines that form the tree, this is the output variable 
treelin = []


#recursive function
def fractal(depth , x2, y2, z2, length, anglerec, angle, lvariation, aran, lran):
    
    #test if depth>0
    if depth:
        
        #defining random angle variation and length variation
        arn = random.uniform(-angle/100*aran, angle/100*aran)
        lrn = random.uniform(-length/100*lran, length/100*lran)
        
        #defining points
        x1 = x2
        y1 = y2
        z1 = z2
        x2 = x1 + (length+lrn)*cos(radians(anglerec))
        y2 = y1 + (length+lrn)*sin(radians(anglerec))
        
        #changing branch length dependant on branch depth
        length = length*lvariation
        
        #building points
        stpoint = [x1, y1, z1]
        endpoint = [x2, y2, z2]
        
        #building line between points
        treelin.append(rs.AddLine(stpoint, endpoint))
        
        #calling function with different angle parameter for branch splitting
        fractal(depth - 1 , x2, y2, z2, length, (anglerec+angle+arn), angle, lvariation, aran, lran)
        fractal(depth - 1 , x2, y2, z2, length, (anglerec-angle+arn), angle, lvariation, aran, lran)
        
#first recursive function call
fractal(depth, x2, y2, z2, length, anglerec, angle, lvariation, aran, lran)
# ---------- end ghpython_script ----------
rotate_axis = RotateAxis(Geometry=ghpython_script.treelin, Angle=degrees(Slider(-90, range=-90..100)), Axis=line_sdl)  # -> Geometry, Transform
